# Grasshopper definition Final UMBRACLE.gh (Grasshopper 1.0.8)

# ----
# Part 1 _ Context ___ METHOD 1
# Example for linking vsc with gh
file_path = FilePath("C:\MPDA\Umbracle\Part1_Context.py")
read_file = ReadFile(File=file_path, PerLineParse=False)
python_3_script = Python3Script(
    script=read_file,
    tri_side=Slider(14, range=0..100),
    count_A=Slider(5, range=0..100),
    count_B=Slider(4, range=0..100),
    count_C=Slider(5, range=0..100),
    main_rad=Slider(3, range=0..100),
    min_r=Slider(4, range=0..100),
    max_r=Slider(18, range=0..100),
    fillet_val=Slider(0, range=0..100),
    seed=Slider(23, range=0..100),
    r=Slider(4, range=0..100))  # -> out, main_circles, secondary_circles, boundary_curves, individual_surfaces; unedited script template
curve = Curve(python_3_script.secondary_circles)
curve_2 = Curve(python_3_script.boundary_curves)
surface = Surface(python_3_script.individual_surfaces)
curve_3 = Curve(python_3_script.main_circles)

# ----
# Part 1 _ Context ___ METHOD 2
number_slider = Slider(14, range=0..100)
python_3_script_2 = Python3Script(
    tri_side=number_slider,
    count_A=Slider(5, range=0..100),
    count_B=Slider(4, range=0..100),
    count_C=Slider(5, range=0..100),
    main_rad=Slider(3, range=0..100),
    min_r=Slider(4, range=0..100),
    max_r=Slider(18, range=0..100),
    fillet_val=Slider(0, range=0..100),
    seed=Slider(23, range=0..100),
    r=Slider(4, range=0..100))  # -> out, main_circles, secondary_circles, boundary_curves, individual_surfaces
# ---------- python_3_script_2: Python ----------
import Rhino.Geometry as rg
import math
import random

# Initialize output lists
main_circles = []
secondary_circles = []
boundary_curves = []
individual_surfaces = []

# --- INPUTS ---
# tri_side, main_rad, count_A, count_B, count_C, r (list), fillet_val, seed (int)

# 1. Fixing Randomness (Seed)
# This ensures that when you change tri_side, the SHAPES stay the same
random.seed(seed)

# 2. Setup Centers (Equilateral Triangle)
h = (math.sqrt(3) / 3) * tri_side
centers = [
    rg.Point3d(0, h, 0),
    rg.Point3d(-tri_side / 2, -h / 2, 0),
    rg.Point3d(tri_side / 2, -h / 2, 0)
]
counts = [int(count_A), int(count_B), int(count_C)]

# Extract radius domain from list 'r'
# Extract radius domain safely
if isinstance(r, list):
    r_min, r_max = min(r), max(r)
else:
    # If r is just a single number, min and max are the same
    r_min = r_max = r

for i in range(3):
    center = centers[i]
    
    # Output 1: Main Base Circles
    main_c = rg.Circle(center, main_rad).ToNurbsCurve()
    main_circles.append(main_c)
    
    # 3. Create Secondary Circles
    group_circles = []
    for _ in range(counts[i]):
        # Random distribution relative to (0,0,0) first to keep shape static
        r_dist = main_rad * math.sqrt(random.random())
        theta = random.random() * 2 * math.pi
        
        # Local point (before moving to triangle center)
        local_pt = rg.Point3d(r_dist * math.cos(theta), r_dist * math.sin(theta), 0)
        
        # Random radius for this specific circle
        sec_r = random.uniform(r_min, r_max)
        sec_c = rg.Circle(local_pt, sec_r).ToNurbsCurve()
        group_circles.append(sec_c)

    # 4. Create Boundary (Union) at Origin for Stability
    # We union them at 0,0,0 so the calculation is more precise
    union_results = rg.Curve.CreateBooleanUnion(group_circles, 0.001)
    
    if union_results:
        # Get the outermost boundary
        crv = union_results[0]
        
        # Smooth the joins
        smoothed = rg.Curve.CreateFilletCornersCurve(crv, fillet_val, 0.001, 0.001)
        final_crv = smoothed if smoothed else crv
        
        # --- ALIGNMENT LOGIC ---
        # Move the static organic shape to the triangle vertex center
        # This keeps the shape identical even when tri_side changes
        final_crv.Translate(rg.Vector3d(center))
        boundary_curves.append(final_crv)
        
        # Move the secondary circles to the center for visualization
        for c_sec in group_circles:
            c_sec.Translate(rg.Vector3d(center))
            secondary_circles.append(c_sec)
            
        # Output 4: Individual Surfaces
        srf = rg.Brep.CreatePlanarBreps(final_crv, 0.001)
        if srf:
            individual_surfaces.append(srf[0])

# Assign to Grasshopper Outputs
a = main_circles
b = secondary_circles
c = boundary_curves
d = individual_surfaces
# ---------- end python_3_script_2 ----------
curve_4 = Curve(python_3_script_2.boundary_curves)
curve_5 = Curve(python_3_script_2.secondary_circles)
surface_2 = Surface(python_3_script_2.individual_surfaces)
curve_6 = Curve(python_3_script_2.main_circles)

list_item = ListItem(List=surface_2, Index=0, Wrap=True)  # -> Item, Item1, Item2
curve_7 = Curve(list_item.Item)
curve_8 = Curve(list_item.Item2)
curve_9 = Curve(list_item.Item1)
merge = Merge(Data1=curve_7, Data2=curve_9, Data3=curve_8)

python_3_script_3 = Python3Script(
    Curves=merge,
    count=Slider(36, range=5..50),
    d_min=Slider(0.4, range=0..1),
    d_max=Slider(5.1, range=0..10),
    h_start=Slider(2, range=0..10),
    h_end=Slider(6, range=0..10),
    ratio=Slider(0.3, range=0.1..1),
    offset_dist=Slider(3.2, range=0..10),
    num_voro=Slider(10, range=5..50))  # -> out, a, b, c, d, e, f, g; inputs Curves: list of Curve, count: Int32, d_min: Double, d_max: Double, h_start: Double, h_end: Double, ratio: Double, offset_dist: Double, num_voro: Int32, CurvesGH: Curve
# ---------- python_3_script_3: Python ----------
import Rhino.Geometry as rg
import Grasshopper as gh
import Grasshopper.Kernel.Data as ghd
import random

def get_smooth_division(target_crv, other_curves, num_pts, d_min, d_max):
    # Parámetros de muestreo
    samples = 150
    params = target_crv.DivideByCount(samples, True)
    dist_map = []
    
    for t in params:
        pt = target_crv.PointAt(t)
        min_d = float("inf")
        for other in other_curves:
            if other == target_crv: continue
            _, t_close = other.ClosestPoint(pt)
            dist = pt.DistanceTo(other.PointAt(t_close))
            if dist < min_d: min_d = dist
        dist_map.append(min_d)
    
    d_low, d_high = min(dist_map), max(dist_map)
    range_d = (d_high - d_low) if d_high > d_low else 1.0
    
    cumulative_lengths, current_length = [0.0], 0.0
    for i in range(len(params) - 1):
        t_map = (dist_map[i] - d_low) / range_d
        density = 1.0 / (d_min + (d_max - d_min) * t_map)
        current_length += (params[i+1] - params[i]) * density
        cumulative_lengths.append(current_length)
    
    final_pts = []
    for j in range(num_pts):
        target_val = (j / float(num_pts - 1)) * cumulative_lengths[-1]
        for k in range(len(cumulative_lengths) - 1):
            if cumulative_lengths[k] <= target_val <= cumulative_lengths[k+1]:
                t = params[k] + (target_val - cumulative_lengths[k]) / (cumulative_lengths[k+1] - cumulative_lengths[k]) * (params[k+1] - params[k])
                final_pts.append(target_crv.PointAt(t))
                break
    return final_pts

# --- PROCESAMIENTO PRINCIPAL ---
p_base_tree = gh.DataTree[rg.Point3d]()
p_top_tree = gh.DataTree[rg.Point3d]()
l_tree = gh.DataTree[rg.Line]()
arc_tree = gh.DataTree[rg.ArcCurve]()
all_top_geo = []
temp_offsets = []
used_ids = set()
all_groups = []

# 1. Generación de Puntos Elevados y Líneas Base
for i in range(len(Curves)):
    path = ghd.GH_Path(i)
    # Offsets para el contorno final
    off_res = Curves[i].Offset(rg.Plane.WorldXY, offset_dist, 0.01, rg.CurveOffsetCornerStyle.Round)
    if off_res: temp_offsets.extend(off_res)
    
    pts = get_smooth_division(Curves[i], Curves, count, d_min, d_max)
    group = []
    for j, p in enumerate(pts):
        h = random.uniform(h_start + i, h_end + i)
        p_top = p + rg.Vector3d(0, 0, h)
        p_base_tree.Add(p, path)
        p_top_tree.Add(p_top, path)
        l_tree.Add(rg.Line(p, p_top), path)
        all_top_geo.append(rg.Point(p_top))
        group.append({'pt': p_top, 'id': (i, j)})
    all_groups.append(group)

# 2. Conexiones en Arco (Emparejamiento 1 a 1 entre ramas)
for i in range(len(all_groups)):
    num_to_process = int(len(all_groups[i]) * ratio)
    count_proc = 0
    for item in all_groups[i]:
        if count_proc >= num_to_process: break
        if item['id'] in used_ids: continue
        
        pt_a, best_partner, min_d = item['pt'], None, float("inf")
        for other_idx in range(len(all_groups)):
            if i == other_idx: continue
            for other_item in all_groups[other_idx]:
                if other_item['id'] not in used_ids:
                    d = pt_a.DistanceTo(other_item['pt'])
                    if d < min_d:
                        min_d = d
                        best_partner = other_item
        
        if best_partner:
            used_ids.add(item['id'])
            used_ids.add(best_partner['id'])
            mid = (pt_a + best_partner['pt']) / 2.0
            mid.Z += pt_a.DistanceTo(best_partner['pt']) * 0.25
            arc_tree.Add(rg.ArcCurve(rg.Arc(pt_a, mid, best_partner['pt'])), ghd.GH_Path(i))
            count_proc += 1

# 3. Creación de Superficie de Cobertura y Recorte
raw_surf = rg.Brep.CreatePatch(all_top_geo, 20, 20, 0.01)
f_surf = None
ext_brep = None
comb_bound = None

if raw_surf:
    # Asegurar objeto individual desde Patch
    srf_base = raw_surf[0] if hasattr(raw_surf, "__len__") else raw_surf
    face = srf_base.Faces[0]
    # Extensión para asegurar que el recorte sea limpio
    ext = face.Extend(rg.IsoStatus.North, offset_dist, True).Extend(rg.IsoStatus.South, offset_dist, True).Extend(rg.IsoStatus.East, offset_dist, True).Extend(rg.IsoStatus.West, offset_dist, True)
    ext_brep = ext.ToBrep()
    
    # Unión de offsets para el contorno de recorte
    comb_bound = rg.Curve.CreateBooleanUnion(temp_offsets, 0.01)
    if comb_bound:
        projs = []
        for crv in comb_bound:
            res = rg.Curve.ProjectToBrep(crv, ext_brep, rg.Vector3d(0,0,1), 0.01)
            if res: projs.extend(res)
        
        if projs:
            splits = ext_brep.Split(projs, 0.01)
            if splits:
                # Seleccionar la pieza central por proximidad al centroide del contorno
                mid_pt = rg.AreaMassProperties.Compute(comb_bound[0]).Centroid
                f_surf = sorted(splits, key=lambda s: rg.AreaMassProperties.Compute(s).Centroid.DistanceTo(mid_pt))[0]

# Salidas
a = p_base_tree
b = l_tree
c = p_top_tree
d = arc_tree
e = ext_brep
f = f_surf
g = comb_bound
# ---------- end python_3_script_3 ----------
point = Point(python_3_script_3.a)
line = Line(python_3_script_3.b)
curve_10 = Curve(python_3_script_3.g)
surface_3 = Surface(python_3_script_3.e)
point_2 = Point(python_3_script_3.c)
curve_11 = Curve(python_3_script_3.d)
surface_4 = Surface(python_3_script_3.f)

# ----
# Part 2 _ Structure
number_slider_2 = Slider(89, range=0..100)
python_3_script_4 = Python3Script(S=surface_4, N=number_slider_2, Seed=Slider(100, range=0..100), T=Slider(0.1, range=0..10))  # -> out, a, b, c, d, e, f, g; inputs S: Brep
# ---------- python_3_script_4: Python ----------
import Rhino.Geometry as rg
import ghpythonlib.components as ghc
import rhinoscriptsyntax as rs

def create_voronoi_master(surf_input, count, seed, tol):
    # 1. Convert to Brep
    brep = rs.coercebrep(surf_input)
    if not brep: 
        print("Error: S is not a valid Brep/Surface")
        return [], [], [], [], [], [], [] # Updated to 7 outputs

    # --- ROBUST BOUNDARY DETECTION ---
    naked_edges = brep.DuplicateNakedEdgeCurves(True, True)
    if len(naked_edges) == 0:
        print("Error: No boundary found.")
        return [], [], [], [], [], [], [] # Updated to 7 outputs
    
    boundary_union = rg.Curve.JoinCurves(naked_edges)[0]

    # 2. Populate Points
    pop_points = ghc.PopulateGeometry(brep, count, seed)
    
    # 3. Voronoi
    bbox = brep.GetBoundingBox(True)
    bbox.Inflate(2.0) 
    voronoi_cells = ghc.Voronoi(pop_points, 1000000, bbox)
    
    exploded_segments = []
    all_corner_points = []
    all_centers = []
    closed_centers = [] 
    open_centers = []
    closed_corner_points = []
    closed_curves = [] # <--- NEW: List for Output G
    
    proj_vector = rg.Vector3d(0, 0, 1) 
    
    for cell in voronoi_cells:
        proj = rg.Curve.ProjectToBrep(cell, brep, proj_vector, 0.01)
        if proj:
            for p_curve in proj:
                # --- CALCULATE CENTER ---
                success, poly = p_curve.TryGetPolyline()
                if not success:
                    poly = p_curve.ToPolyline(0, 0, 0, 0, 0, 0.1, 0, 0, True).ToPolyline()
                
                if poly.Count > 0:
                    sum_pt = rg.Point3d(0,0,0)
                    for pt in poly: sum_pt += pt
                    center = sum_pt / poly.Count
                    all_centers.append(center)
                    
                    # --- BOUNDARY DETECTION LOGIC ---
                    is_on_boundary = False
                    cell_corners = []
                    
                    for v_pt in poly:
                        cell_corners.append(v_pt)
                        # Check distance to boundary
                        _, t_param = boundary_union.ClosestPoint(v_pt, 0.0)
                        dist = v_pt.DistanceTo(boundary_union.PointAt(t_param))
                        
                        if dist <= tol: 
                            is_on_boundary = True
                            # Note: We don't break here because we need all corners for Output B
                    
                    if is_on_boundary:
                        open_centers.append(center)
                    else:
                        closed_centers.append(center)
                        # ADD ONLY THESE CORNERS TO OUTPUT F
                        closed_corner_points.extend(cell_corners)
                        # ADD THE WHOLE CLOSED CURVE TO OUTPUT G
                        closed_curves.append(p_curve) # <--- NEW

                # --- ALL SEGMENTS & ALL CORNERS (Output A & B) ---
                segments = p_curve.DuplicateSegments()
                if segments:
                    exploded_segments.extend(segments)
                    for seg in segments:
                        all_corner_points.append(seg.PointAtStart)
            
    return exploded_segments, all_corner_points, all_centers, closed_centers, open_centers, closed_corner_points, closed_curves

# --- EXECUTION ---
t_val = T if T is not None else 0.5

if S:
    res = create_voronoi_master(S, N, Seed, t_val)
    a, b, c, d, e, f, g = res # <--- NEW: Added 'g' to unpack the curves
# ---------- end python_3_script_4 ----------
curve_12 = Curve(python_3_script_4.a)
point_3 = Point(python_3_script_4.f)
point_4 = Point(python_3_script_4.b)
point_5 = Point(python_3_script_4.c)
point_6 = Point(python_3_script_4.e)
point_7 = Point(python_3_script_4.d)

python_3_script_5 = Python3Script(S=surface_4, C=curve_12, D1=Slider(0.1, range=0..1), D2=Slider(0.1, range=0..1), R=Slider(0.03, range=0..0.1))  # -> out, a, b, c; inputs S: Brep, C: list of Curve, D1: Double, D2: Double, R: Double
# ---------- python_3_script_5: Python ----------
import Rhino.Geometry as rg
import ghpythonlib.components as ghc

def process_voronoi_robust(base_surf, voronoi_curves, offset_dist, extrude_dist, pipe_rad):
    if not base_surf or not voronoi_curves:
        return [], [], []

    frames = []
    pipe_lines = []
    all_points = [] # New list to store the webbing points
    
    face = base_surf.Faces[0]
    normal = face.NormalAt(face.Domain(0).Mid, face.Domain(1).Mid)

    for crv in voronoi_curves:
        if not crv: continue
        
        off_crv_list = crv.OffsetOnSurface(face, offset_dist, 0.001)
        
        if off_crv_list and len(off_crv_list) > 0:
            inner_crv = off_crv_list[0]
            
            # Loft & Extrude Logic
            loft_res = rg.Brep.CreateFromLoft([crv, inner_crv], rg.Point3d.Unset, rg.Point3d.Unset, rg.LoftType.Normal, False)
            if loft_res:
                edge_srf = loft_res[0]
                extrusion = rg.Brep.CreateFromOffsetFace(edge_srf.Faces[0], extrude_dist, 0.001, True, True)
                if extrusion:
                    frames.append(extrusion)

                # Webbing Point Logic
                area_props = rg.AreaMassProperties.Compute(inner_crv)
                if area_props:
                    web_pt = area_props.Centroid + (normal * (extrude_dist * 0.66))
                    all_points.append(web_pt) # Store the point
                    
                    poly = crv.ToPolyline(0, 0, 0, 0)
                    if poly:
                        for pt in poly:
                            pipe_lines.append(rg.LineCurve(web_pt, pt))

    # MultiPipe Logic
    web_pipe = None
    if pipe_lines:
        web_pipe = ghc.MultiPipe(pipe_lines, pipe_rad, 1.0, 1.0, 0, 0.6, 0)

    # Now returning THREE things
    return frames, web_pipe, all_points

# --- Execution ---
if S and C:
    # We catch the three returned items here
    res_frames, res_pipes, res_pts = process_voronoi_robust(S, C, D1, D2, R)
    a = res_frames
    b = res_pipes
    c = res_pts # Assign the points to output 'c'
else:
    a, b, c = [], None, []
# ---------- end python_3_script_5 ----------
brep = Brep(python_3_script_5.a)

python_3_script_6 = Python3Script(Lines=flatten(line), Surface=surface_4, VoroCurves=flatten(curve_12))  # -> out, a, b, c, d; inputs Lines: Curve, Surface: Brep
# ---------- python_3_script_6: Python ----------
import Rhino.Geometry as rg

def process_structure(lines, srf):
    adjusted_lines = []
    points_2_3 = []
    partial_lines = [] # New list for the 2/3 length lines
    
    if not srf or not lines:
        return [], [], []

    for item in lines:
        # 1. Aseguramos que tenemos geometría de línea
        if hasattr(item, "ToNurbsCurve"):
            line_crv = item
        else:
            continue
            
        p_start = line_crv.PointAtStart
        p_end = line_crv.PointAtEnd
        
        # Identificar base (suelo) y tope (superficie)
        base_pt = p_start if p_start.Z < p_end.Z else p_end
        top_pt = p_end if p_start.Z < p_end.Z else p_start
        
        # Creamos la línea definitiva ajustada (Full length)
        final_line = rg.Line(base_pt, top_pt)
        adjusted_lines.append(final_line)
        
        # 2. Calcular el punto a 2/3 (66.6% de la altura)
        pt_target = final_line.PointAt(2.0 / 3.0)
        points_2_3.append(pt_target)
        
        # 3. Crear la línea parcial (Desde el suelo hasta el punto 2/3)
        short_line = rg.Line(base_pt, pt_target)
        partial_lines.append(short_line)
                
    return adjusted_lines, points_2_3, partial_lines

# --- EJECUCIÓN ---
input_list = Lines if hasattr(Lines, "__iter__") else [Lines]

# Obtenemos los resultados
res_lines, res_points, res_partial = process_structure(input_list, Surface)

# Salidas
a = res_lines   # Líneas completas
b = res_points  # Puntos a 2/3 de altura
c = Surface     # Superficie original
d = res_partial # NUEVO: Líneas que representan el 2/3 inferior
# ---------- end python_3_script_6 ----------
curve_13 = Curve(python_3_script_6.d)
number_slider_3 = Slider(0, range=0..1)
point_8 = Point(python_3_script_6.b)
line_2 = Line(python_3_script_6.a)
python_3_script_7 = Python3Script(pts_a=graft(point_4), pts_b=flatten(point_8), D1="-0.2", D2=Slider(0.1, range=0..1), R=Slider(0.03, range=0..0.1))  # -> out, a, b; inputs pts_a: list of Point3d, pts_b: list of Point3d, D1: Double, D2: Double
# ---------- python_3_script_7: Python ----------
import Rhino.Geometry as rg

def connect_with_rectangular_logic(pts_a, pts_b, offset_dist, extrude_dist, thickness):
    if not pts_a or not pts_b:
        return [], []

    final_frames = []
    final_curves = []
    offset_vec = rg.Vector3d(0, 0, offset_dist)
    tol = 0.001

    for p_a in pts_a:
        # 1. Find 2 Closest Points in B
        distances = []
        for p_b in pts_b:
            dist = p_a.DistanceTo(p_b)
            distances.append((dist, p_b))
        
        distances.sort(key=lambda x: x[0])
        closest_two = distances[:2]
        
        for dist, p_b in closest_two:
            # 2. Shift points by D1 (Offset)
            moved_a = p_a + offset_vec
            moved_b = p_b + offset_vec
            
            # 3. Create and store the Base Line Curve
            line_dir = moved_b - moved_a
            if line_dir.Length < tol: continue
            
            ln_crv = rg.LineCurve(moved_a, moved_b)
            final_curves.append(ln_crv) # Output for 'a'
            
            # 4. Create Rectangular Frame logic
            plane_origin = moved_a
            world_z = rg.Vector3d.ZAxis
            
            # Create a vertical plane aligned with the line direction
            line_plane = rg.Plane(plane_origin, line_dir, world_z)
            
            # Create the rectangle (Length x Height)
            rect = rg.Rectangle3d(line_plane, rg.Interval(0, line_dir.Length), rg.Interval(0, extrude_dist))
            
            # Surface from rectangle
            base_face = rg.Brep.CreateFromCornerPoints(
                rect.Corner(0), rect.Corner(1), rect.Corner(2), rect.Corner(3), tol
            )
            
            if base_face:
                # 5. Extrude the face to give it thickness (the "Rectangular Pipe" look)
                thick_frame = rg.Brep.CreateFromOffsetFace(base_face.Faces[0], thickness, tol, True, True)
                if thick_frame:
                    final_frames.append(thick_frame) # Output for 'b'

    return final_curves, final_frames

# --- Execution ---
# Ensure inputs match: pts_a (List), pts_b (List), D1 (Float), D2 (Float), R (Float)
if pts_a and pts_b:
    curves, frames = connect_with_rectangular_logic(pts_a, pts_b, D1, D2, R)
    a = curves  # Output 'a': The lines connecting the points
    b = frames  # Output 'b': The 3D rectangular extrusions
else:
    a, b = [], []
# ---------- end python_3_script_7 ----------
brep_2 = Brep(python_3_script_7.b)
curve_14 = Curve(python_3_script_7.a)
end_points = EndPoints(Curve=curve_14)  # -> Start, End
unit_z = UnitZ(Factor=Slider(-5.6, range=-10..-5))
python_3_script_8 = Python3Script(p=end_points.End, v=unit_z, s=surface_2)  # -> out, a, b; inputs p: list of Point3d, v: Vector3d, s: Brep
# ---------- python_3_script_8: Python ----------
import Rhino.Geometry as rg

def process_geometry(points, move_vec, surface):
    new_points = []
    lines = []
    trimmed_lines = []

    for pt in points:
        # 1. Move the point
        # move_vec should be a vector (e.g., 0,0,10) scaled by your slider
        moved_pt = pt + move_vec
        new_points.append(moved_pt)
        
        # 2. Create the line
        full_line = rg.LineCurve(pt, moved_pt)
        lines.append(full_line)
        
        # 3. Trim with the surface
        # We find the intersection points between the line and the surface
        # tolerance is usually set to the document tolerance
        tol = 0.001
        rc, curves, intersection_pts = rg.Intersect.Intersection.CurveBrep(full_line, surface, tol)
        
        if rc and intersection_pts:
            # If we found an intersection, we create a line from the start 
            # to the first intersection point found
            trimmed_line = rg.LineCurve(pt, intersection_pts[0])
            trimmed_lines.append(trimmed_line)
        else:
            # If no intersection, keep the full line or handle as needed
            trimmed_lines.append(full_line)
            
    return new_points, trimmed_lines

# --- Component Inputs ---
# p: List Access, Point3d
# v: Item Access, Vector3d (This is your slider * Direction)
# s: Item Access, Brep (Your surface)

a, b = process_geometry(p, v, s)
# ---------- end python_3_script_8 ----------
python_3_script_9 = Python3Script(Lines=python_3_script_8.b, D1=Slider(0, range=0..1), D2=Slider(0.2, range=0..1), R=Slider(0.05, range=0..0.1))  # -> out, a; inputs Lines: list of Curve, D1: Double, D2: Double, R: Double
# ---------- python_3_script_9: Python ----------
import Rhino.Geometry as rg

def extrude_lines_to_frames_centered(input_lines, offset_dist, extrude_height, thickness):
    if not input_lines:
        return []

    final_frames = []
    # Vertical offset vector for the height position (D1)
    offset_vec = rg.Vector3d(0, 0, offset_dist)
    tol = 0.001

    for item in input_lines:
        if not item: continue
        
        # 1. Get the curve and apply the vertical offset (D1)
        if hasattr(item, "Duplicate"):
            crv = item.Duplicate()
            crv.Translate(offset_vec)
        else: continue
            
        p1 = crv.PointAtStart
        p2 = crv.PointAtEnd
        line_dir = p2 - p1
        
        if line_dir.Length < tol: continue
        
        # 2. Create the Vertical Plane along the line
        z_axis = rg.Vector3d.ZAxis
        if abs(rg.Vector3d.VectorAngle(line_dir, z_axis)) < tol:
            plane = rg.Plane(p1, line_dir, rg.Vector3d.XAxis)
        else:
            plane = rg.Plane(p1, line_dir, z_axis)

        if plane is None or not plane.IsValid: continue

        # 3. Create the Vertical Face (Height = D2)
        # Length interval is [0 to LineLength]
        # Height interval is [0 to ExtrudeHeight]
        rect = rg.Rectangle3d(plane, rg.Interval(0, line_dir.Length), rg.Interval(0, extrude_height))
        
        base_face = rg.Brep.CreateFromCornerPoints(
            rect.Corner(0), rect.Corner(1), rect.Corner(2), rect.Corner(3), tol
        )
        
        if base_face:
            # 4. DOUBLE OFFSET (Thickness = R)
            # To make it offset from both sides, we use a centered interval
            half_thick = thickness / 2.0
            
            # CreateFromOffsetFace with a single distance offsets in one direction.
            # To get a centered double-sided offset, we offset the face by -half_thick first, 
            # then extrude it by the full thickness.
            
            # Move the base face back by half the thickness to center it
            side_offset_vec = plane.ZAxis * -half_thick
            base_face.Translate(side_offset_vec)
            
            # Now extrude the face by the full thickness 'R' to make it symmetrical
            thick_frame = rg.Brep.CreateFromOffsetFace(base_face.Faces[0], thickness, tol, True, True)
            
            if thick_frame:
                final_frames.append(thick_frame)

    return final_frames

# --- EXECUTION ---
# Lines: List Access, Curve Hint
# D1: Vertical Offset
# D2: Frame Height
# R: Total Thickness (Centered)
input_list = Lines if isinstance(Lines, list) else [Lines]

if input_list:
    a = extrude_lines_to_frames_centered(input_list, D1, D2, R)
else:
    a = []
# ---------- end python_3_script_9 ----------

# ----
# Part 3 _ Kinetric Shell __ METHOD 1
# Example for linking vsc with gh
number_slider_4 = Slider(1.1, range=-5..5)
unit_z_2 = UnitZ(Factor=number_slider_4)
unit_y = UnitY(Factor=Slider(0, range=-5..5))
unit_x = UnitX(Factor=Slider(0.3, range=-5..5))
file_path_2 = FilePath("C:\MPDA\Umbracle\Part3_kineticshell.py")
move = Move(Geometry=point_7, Motion=[unit_z_2, unit_y, unit_x])  # -> Geometry, Transform
read_file_2 = ReadFile(File=file_path_2, PerLineParse=False)
curve_15 = Curve(python_3_script_4.g)
python_3_script_10 = Python3Script(
    script=read_file_2,
    C=graft(curve_15),
    P=graft(move.Geometry),
    dX=Slider(0.3, range=-5..5),
    dY=Slider(-0.1, range=-5..5),
    dZ=Slider(0.8, range=-5..5),
    Factor=Slider(0.6, range=0..1))  # -> out, a, b, c, d; inputs C: list of Curve, P: list of Point3d, dX: Double, dY: Double, dZ: Double, Factor: Double; unedited script template
curve_16 = Curve(python_3_script_10.a)
mesh = Mesh(python_3_script_10.b)
point_9 = Point(python_3_script_10.c)
mesh_2 = Mesh(python_3_script_10.d)

# ----
# Part 3 _ Kinetric Shell __ METHOD 2
number_slider_5 = Slider(1.1, range=-5..5)
unit_z_3 = UnitZ(Factor=number_slider_5)
unit_y_2 = UnitY(Factor=Slider(0, range=-5..5))
unit_x_2 = UnitX(Factor=Slider(0.3, range=-5..5))
move_2 = Move(Geometry=point_7, Motion=[unit_z_3, unit_y_2, unit_x_2])  # -> Geometry, Transform
curve_17 = Curve(python_3_script_4.g)
python_3_script_11 = Python3Script(
    C=graft(curve_17),
    P=graft(move_2.Geometry),
    dX=Slider(0.3, range=-5..5),
    dY=Slider(-0.1, range=-5..5),
    dZ=Slider(0.8, range=-5..5),
    Factor=Slider(0.6, range=0..1))  # -> out, a, b, c, d; inputs C: list of Curve, P: list of Point3d, dX: Double, dY: Double, dZ: Double, Factor: Double
# ---------- python_3_script_11: Python ----------
import Rhino.Geometry as rg

# 1. Handle Branching Data
try:
    cell_curve = C[0]
    original_center = P[0]
except:
    cell_curve = C
    original_center = P

all_lines = []
kinetic_meshes = []
static_meshes = []

if isinstance(original_center, rg.Point3d) and cell_curve:
    
    # Create the dynamic center point
    center_pt = rg.Point3d(
        original_center.X + dX,
        original_center.Y + dY,
        original_center.Z + dZ
    )
    
    segments = cell_curve.DuplicateSegments()
    
    if segments:
        original_verts = [s.PointAtStart for s in segments]
        final_verts = []
        
        # Determine if we use Kinetic logic (6 sides) or Static logic (rest)
        is_hexagon = len(segments) == 6
        
        for i in range(len(original_verts)):
            p = original_verts[i]
            
            if is_hexagon:
                # Kinetic Logic: Move points 2, 4, 6
                if (i + 1) % 2 == 0:
                    vector = center_pt - p
                    final_verts.append(p + (vector * Factor))
                else:
                    final_verts.append(p)
            else:
                # Static Logic: All points stay at original boundary
                final_verts.append(p)
        
        # 2. Build the Geometry
        loop_verts = final_verts + [final_verts[0]]
        
        for j in range(len(loop_verts) - 1):
            p1 = loop_verts[j]
            p2 = loop_verts[j+1]
            
            # Lines
            all_lines.append(rg.Line(center_pt, p1).ToNurbsCurve())
            
            # Create Mesh Triangle
            m = rg.Mesh()
            m.Vertices.Add(center_pt)
            m.Vertices.Add(p1)
            m.Vertices.Add(p2)
            m.Faces.AddFace(0, 1, 2)
            
            if is_hexagon:
                kinetic_meshes.append(m)
            else:
                static_meshes.append(m)

# Final Outputs
a = all_lines
b = kinetic_meshes
c = center_pt
d = static_meshes
# ---------- end python_3_script_11 ----------
curve_18 = Curve(python_3_script_11.a)
point_10 = Point(python_3_script_11.c)
mesh_3 = Mesh(python_3_script_11.b)
mesh_4 = Mesh(python_3_script_11.d)

surface_5 = Surface(list_item.Item)
surface_6 = Surface(list_item.Item1)
surface_7 = Surface(list_item.Item2)
# Part 4 _ Plants Part
number_slider_6 = Slider(0.2, range=0..1)
file_path_3 = FilePath("C:\MPDA\Umbracle\Desert_Plants_Groundhog.csv")
number_slider_7 = Slider(11, range=0..100)
construct_domain = ConstructDomain(DomainStart=Slider(0.2, range=0..1), DomainEnd=Slider(2.6, range=0..10))
construct_domain_2 = ConstructDomain(DomainStart=Slider(0.2, range=0..1), DomainEnd=Slider(2.6, range=0..10))
construct_domain_3 = ConstructDomain(DomainStart=number_slider_6, DomainEnd=Slider(2.6, range=0..10))
construct_domain_4 = ConstructDomain(DomainStart=Slider(0.2, range=0..1), DomainEnd=Slider(1.7, range=0..10))
construct_domain_5 = ConstructDomain(DomainStart=Slider(0.2, range=0..1), DomainEnd=Slider(1.7, range=0..10))
file_path_4 = FilePath("C:\MPDA\Umbracle\Tropical_Plants_Groundhog.csv")
construct_domain_6 = ConstructDomain(DomainStart=Slider(0.2, range=0..1), DomainEnd=Slider(1.7, range=0..10))
file_path_5 = FilePath("C:\MPDA\Umbracle\Mediterranean_Plants_Groundhog.csv")
python_3_script_12 = Python3Script(
    N=number_slider_7,
    S=surface_7,
    L=file_path_4,
    HD=construct_domain,
    SD=construct_domain_4,
    H=Slider(21, range=0..100),
    T=Slider(7, range=0..100),
    LH=Slider(14, range=0..100),
    C=Slider(25, range=0..100))  # -> out, a, b, c, d; inputs N: Double, S: Brep, L: list of String, HD: Interval, SD: Interval, H: Double, T: list of Double, LH: Double, C: Int32
# ---------- python_3_script_12: Python ----------
import Rhino.Geometry as rg
import random

# Initialize outputs
pts = []
geo = []
types = []
scales = []

# 1. Validation
if S and HD and SD:
    try:
        # --- FIX: Convert Brep to Surface if necessary ---
        # If it's a Brep, we take the first face. If it's already a Surface, we use it.
        target_srf = S.Faces[0] if hasattr(S, "Faces") else S
        
        u_dom = target_srf.Domain(0)
        v_dom = target_srf.Domain(1)
        
        names = L if (isinstance(L, list) and len(L) > 0) else ["Plant_Type"]
        
        for i in range(int(C)):
            # Random UV
            u = random.uniform(u_dom.Min, u_dom.Max)
            v = random.uniform(v_dom.Min, v_dom.Max)
            pt = target_srf.PointAt(u, v)
            
            # Dimensions
            h = random.uniform(HD.Min, HD.Max)
            s = random.uniform(SD.Min, SD.Max)
            
            p_name = names[i % len(names)]
            
            # Visual Placeholder
            plane = rg.Plane(pt, rg.Vector3d.ZAxis)
            # Create a simple cone
            cone_geo = rg.Cone(plane, h, s/2.0).ToBrep(True)
            
            pts.append(pt)
            geo.append(cone_geo)
            types.append(p_name)
            scales.append(rg.Vector3d(s, s, h))
            
    except Exception as e:
        print("Error during generation: " + str(e))
else:
    print("Waiting for inputs S, HD, and SD...")

# Final Outputs
a = pts
b = geo
c = types
d = scales
# ---------- end python_3_script_12 ----------
python_3_script_13 = Python3Script(
    N=number_slider_7,
    S=surface_6,
    L=file_path_5,
    HD=construct_domain_2,
    SD=construct_domain_5,
    H=Slider(10, range=0..100),
    T=Slider(7, range=0..100),
    LH=Slider(3, range=0..100),
    C=Slider(25, range=0..100))  # -> out, a, b, c, d; inputs N: Double, S: Brep, L: list of String, HD: Interval, SD: Interval, H: Double, T: list of Double, LH: Double, C: Int32; same code as python_3_script_12
python_3_script_14 = Python3Script(
    N=Slider(11, range=0..100),
    S=surface_5,
    L=file_path_3,
    HD=construct_domain_3,
    SD=construct_domain_6,
    H=Slider(10, range=0..100),
    T=Slider(7, range=0..100),
    LH=Slider(3, range=0..100),
    C=Slider(25, range=0..100))  # -> out, a, b, c, d; inputs N: Double, S: Brep, L: list of String, HD: Interval, SD: Interval, H: Double, T: list of Double, LH: Double, C: Int32; same code as python_3_script_12
point_11 = Point(python_3_script_12.a)
point_12 = Point(python_3_script_13.a)
geometry = Geometry(python_3_script_12.b)
geometry_2 = Geometry(python_3_script_13.b)
point_13 = Point(python_3_script_14.a)
geometry_3 = Geometry(python_3_script_14.b)

brep_3 = Brep([brep, brep_2, python_3_script_9.a])
# Final Results
surface_8 = Surface(surface_2)
mesh_5 = Mesh([mesh_4, mesh_3])
geometry_4 = Geometry([geometry_3, geometry_2, geometry])
gradient = Gradient(
    LowerLimit=Slider(0.2, range=0..1),
    UpperLimit=Slider(7.3, range=0..10),
    Parameter=geometry_4,
    stops=[0: RGB(0, 98, 0), 0.25: RGB(81, 175, 17), 0.5: RGB(159, 198, 146), 0.75: RGB(170, 235, 41), 1: RGB(221, 255, 53)])
create_material = CreateMaterial(
    Diffuse=ColourSwatch(SwatchColor=RGB(255, 255, 255)),
    Specular=RGB(255, 255, 255),
    Emission=ColourSwatch(SwatchColor=RGB(178, 205, 124)),
    Transparency=Slider(0.5, range=0..1),
    Shine=0)
custom_preview = CustomPreview(Geometry=surface_8, Material=ColourSwatch(SwatchColor=RGB(164, 130, 119)))
custom_preview_2 = CustomPreview(Geometry=brep_3, Material=ColourSwatch(SwatchColor=RGB(104, 106, 119)))
custom_preview_3 = CustomPreview(Geometry=geometry_4, Material=gradient)
custom_preview_4 = CustomPreview(Geometry=mesh_5, Material=create_material)
