# Grasshopper definition UMBRACLE. Volume.gh (Grasshopper 1.0.8)

file_path = FilePath("C:\MPDA\Umbracle\Umbracle\Umbracle.Volume.py")
read_file = ReadFile(File=file_path, PerLineParse=False)
curve = Curve([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])
panel = Panel(read_file)
python_3_script = Python3Script(
    script=read_file,
    input_curves=curve,
    divisions=Slider(5, range=5..50),
    start_param_offset=Slider(0, range=0..1),
    min_distance=Slider(0.5, range=0.5..5),
    max_distance=Slider(2, range=2..20),
    min_height=Slider(1, range=1..20),
    max_height=Slider(2, range=2..50),
    voronoi_offset=Slider(0.1, range=0.1..1),
    extrusion_distance=Slider(0.04, range=0..1))  # -> out, a, division_points, vertical_lines, lofted_surface, voronoi_edges, offset_edges, wall_surfaces, final_extrusions; unedited script template
