# Grasshopper definition YaraVolume.gh (Grasshopper 1.0.8)

panel = Panel("C:\MPDA\Umbracle\Umbracle\Umbracle.Volume.py")
file_path = FilePath("C:\MPDA\Umbracle\YaraVolume.gh")
construct_domain = ConstructDomain(DomainStart=Slider(0, range=0..10), DomainEnd=Slider(6, range=0..10))
construct_domain_2 = ConstructDomain(DomainStart=Slider(1, range=0..10), DomainEnd=Slider(6, range=0..10))
python_3_script = Python3Script(
    tri_side=Slider(14, range=0..100),
    count_A=Slider(5, range=0..100),
    count_B=Slider(4, range=0..100),
    count_C=Slider(5, range=0..100),
    main_rad=Slider(3, range=0..100),
    min_r=Slider(4, range=0..100),
    max_r=Slider(18, range=0..100),
    fillet_val=Slider(0, range=0..100),
    seed=Slider(23, range=0..100),
    r=Slider(4, range=0..100))  # -> out, main_circles, secondary_circles, boundary_curves, individual_surfaces
# ---------- python_3_script: Python ----------
import Rhino.Geometry as rg
import math
import random

# Initialize output lists
main_circles = []
secondary_circles = []
boundary_curves = []
individual_surfaces = []

# --- INPUTS ---
# tri_side, main_rad, count_A, count_B, count_C, r (list), fillet_val, seed (int)

# 1. Fixing Randomness (Seed)
# This ensures that when you change tri_side, the SHAPES stay the same
random.seed(seed)

# 2. Setup Centers (Equilateral Triangle)
h = (math.sqrt(3) / 3) * tri_side
centers = [
    rg.Point3d(0, h, 0),
    rg.Point3d(-tri_side / 2, -h / 2, 0),
    rg.Point3d(tri_side / 2, -h / 2, 0)
]
counts = [int(count_A), int(count_B), int(count_C)]

# Extract radius domain from list 'r'
# Extract radius domain safely
if isinstance(r, list):
    r_min, r_max = min(r), max(r)
else:
    # If r is just a single number, min and max are the same
    r_min = r_max = r

for i in range(3):
    center = centers[i]
    
    # Output 1: Main Base Circles
    main_c = rg.Circle(center, main_rad).ToNurbsCurve()
    main_circles.append(main_c)
    
    # 3. Create Secondary Circles
    group_circles = []
    for _ in range(counts[i]):
        # Random distribution relative to (0,0,0) first to keep shape static
        r_dist = main_rad * math.sqrt(random.random())
        theta = random.random() * 2 * math.pi
        
        # Local point (before moving to triangle center)
        local_pt = rg.Point3d(r_dist * math.cos(theta), r_dist * math.sin(theta), 0)
        
        # Random radius for this specific circle
        sec_r = random.uniform(r_min, r_max)
        sec_c = rg.Circle(local_pt, sec_r).ToNurbsCurve()
        group_circles.append(sec_c)

    # 4. Create Boundary (Union) at Origin for Stability
    # We union them at 0,0,0 so the calculation is more precise
    union_results = rg.Curve.CreateBooleanUnion(group_circles, 0.001)
    
    if union_results:
        # Get the outermost boundary
        crv = union_results[0]
        
        # Smooth the joins
        smoothed = rg.Curve.CreateFilletCornersCurve(crv, fillet_val, 0.001, 0.001)
        final_crv = smoothed if smoothed else crv
        
        # --- ALIGNMENT LOGIC ---
        # Move the static organic shape to the triangle vertex center
        # This keeps the shape identical even when tri_side changes
        final_crv.Translate(rg.Vector3d(center))
        boundary_curves.append(final_crv)
        
        # Move the secondary circles to the center for visualization
        for c_sec in group_circles:
            c_sec.Translate(rg.Vector3d(center))
            secondary_circles.append(c_sec)
            
        # Output 4: Individual Surfaces
        srf = rg.Brep.CreatePlanarBreps(final_crv, 0.001)
        if srf:
            individual_surfaces.append(srf[0])

# Assign to Grasshopper Outputs
a = main_circles
b = secondary_circles
c = boundary_curves
d = individual_surfaces
# ---------- end python_3_script ----------
read_file = ReadFile(File=file_path, PerLineParse=False)
curve = Curve([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])
curve_2 = Curve(python_3_script.secondary_circles)
curve_3 = Curve(python_3_script.boundary_curves)
surface = Surface(python_3_script.individual_surfaces)
curve_4 = Curve(python_3_script.main_circles)
panel_2 = Panel(read_file)
python_3_script_2 = Python3Script(
    script=read_file,
    input_curves=curve,
    divisions=Slider(7, range=5..50),
    start_param_offset=Slider(0.11, range=0..1),
    min_distance=Slider(0.8, range=0.5..5),
    max_distance=Slider(3, range=2..20),
    min_height=Slider(2, range=1..20),
    max_height=Slider(9, range=2..50),
    voronoi_offset=Slider(0.21, range=0.1..1),
    extrusion_distance=Slider(0.18, range=0..1))  # -> out, a, division_points, vertical_lines, lofted_surface, voronoi_edges, offset_edges, wall_surfaces, final_extrusions; unedited script template
list_item = ListItem(List=surface, Index=0, Wrap=True)  # -> Item, Item1, Item2
surface_2 = Surface(list_item.Item)
surface_3 = Surface(list_item.Item1)
surface_4 = Surface(list_item.Item2)
curve_5 = Curve(list_item.Item)
curve_6 = Curve(list_item.Item2)
curve_7 = Curve(list_item.Item1)
point = Point(python_3_script_2.division_points)
merge = Merge(Data1=curve_5, Data2=curve_7, Data3=curve_6)
python_3_script_3 = Python3Script(
    C=merge,
    N=Slider(9, range=5..50),
    StartPos=Slider(0.9, range=0..1),
    DistDomain=construct_domain,
    HeightDomain=construct_domain_2,
    OffsetDist=Slider(2.8, range=0..10),
    ExtrudeDist=Slider(3.7, range=0..10))  # -> out, a, b, c; inputs C: list of Curve, OffsetDist: Double, ExtrudeDist: Double
# ---------- python_3_script_3: Python ----------
import Rhino.Geometry as rg
import math
import random

def generate_separated_surfaces():
    # 1. Verification of Inputs
    if not C or len(C) < 3: 
        print("Please provide at least 3 curves for the multi-surface output.")
        return None, None, None

    # 2. Sort curves spatially (Y-axis) to ensure logical pairing
    sorted_curves = sorted(C, key=lambda crv: crv.GetBoundingBox(True).Center.Y)

    count_int = int(N)
    all_curve_pts = []
    
    # 3. Generate Grid Points
    for i, crv in enumerate(sorted_curves):
        crv.Domain = rg.Interval(0, 1)
        # Apply the 1m height shift per curve index
        shift = i * 1.0 
        h_min = HeightDomain.T0 + shift
        h_max = HeightDomain.T1 + shift
        
        # Proximity references for non-uniform spacing
        other_curves = [sorted_curves[k] for k in range(len(sorted_curves)) if k != i]
        pts_on_this_curve = []

        for j in range(count_int + 1):
            t_base = (j / float(count_int) + StartPos) % 1.0
            pt_ref = crv.PointAtNormalizedLength(t_base)
            
            # Non-uniform spacing logic: distances between points vary by curve proximity
            dist_list = [pt_ref.DistanceTo(oc.PointAt(oc.ClosestPoint(pt_ref)[1])) for oc in other_curves]
            dist_to_others = min(dist_list) if dist_list else 1.0
            repulsion = (1.0 / (dist_to_others + 0.5)) * 0.08
            t_final = (t_base + repulsion) % 1.0
            
            base_pt = crv.PointAtNormalizedLength(t_final)
            h = random.uniform(h_min, h_max)
            pts_on_this_curve.append(rg.Point3d(base_pt.X, base_pt.Y, base_pt.Z + h))
            
        all_curve_pts.append(pts_on_this_curve)

    # 4. Create separate Profile Curves
    profiles = [rg.Curve.CreateInterpolatedCurve(pts, 3) for pts in all_curve_pts]

    # 5. Create Individual Lofts (Separated Outputs)
    separated_surfaces = []
    for i in range(len(profiles) - 1):
        section = [profiles[i], profiles[i+1]]
        # Using LoftType.Loose for smoothness, or .Normal for precision
        loft_group = rg.Brep.CreateFromLoft(section, rg.Point3d.Unset, rg.Point3d.Unset, rg.LoftType.Normal, False)
        
        if loft_group:
            base_face = loft_group[0].Faces[0]
            # 6. Extension logic per surface
            try:
                # Extend the strip sides to reach XY plane/boundaries
                ext = base_face.Extend(0, 10.0, True).Extend(1, 10.0, True)
                separated_surfaces.append(ext)
            except:
                separated_surfaces.append(base_face)

    # 7. Generate Vertical Lines (Output B) and Branches (Output C)
    vert_lines = []
    branch_lines = []
    for group in all_curve_pts:
        for pt in group:
            v_line = rg.Line(rg.Point3d(pt.X, pt.Y, 0), pt)
            vert_lines.append(v_line)
            branch_lines.append(rg.Line(v_line.PointAt(0.66), pt))

    return separated_surfaces, vert_lines, branch_lines

# --- Execution ---
# 'a' will now be a list of 2 separate surfaces
a, b, c = generate_separated_surfaces()
# ---------- end python_3_script_3 ----------
curve_8 = Curve(python_3_script_3.c)
curve_9 = Curve(python_3_script_3.b)
surface_5 = Surface(python_3_script_3.a)
list_item_2 = ListItem(List=surface_5, Index=0, Wrap=True)  # -> Item, Item1, Item2
